# Grasshopper definition Lighthouse-DEMO.gh (Grasshopper 1.0.7)
# plug-ins: ProceduralCS

# ----
# Mesh Settings
number_slider = Slider(0, range=0..100)
custom_mesh_settings = SettingsCustom(
    StitchSeams=True,
    SimplePlanes=Toggle(True),
    Refine=True,
    MinCount=number_slider,
    MaxCount=400,
    AspectRatio=20,
    MaxDistance=0,
    MaxAngle=Slider(60, range=0..100),
    MinEdge=0,
    MaxEdge=0)

# ----
# GEOMETRY
pipeline = GeometryPipeline(
    GroupByLayer=False,
    GroupByType=False,
    IncludeHidden=True,
    IncludeLocked=True,
    LayerFilter="Context - Near::Buildings",
    NameFilter="*",
    SublayerFiltering=True,
    TypeFilter=1073741848)
pipeline_2 = GeometryPipeline(
    GroupByLayer=False,
    GroupByType=False,
    IncludeHidden=True,
    IncludeLocked=True,
    LayerFilter="Site::Refinement",
    NameFilter="*",
    SublayerFiltering=True,
    TypeFilter=1073741848)
pipeline_3 = GeometryPipeline(
    GroupByLayer=False,
    GroupByType=False,
    IncludeHidden=True,
    IncludeLocked=True,
    LayerFilter="Context - Far::Ground",
    NameFilter="*",
    SublayerFiltering=True,
    TypeFilter=1073741848)
pipeline_4 = GeometryPipeline(
    GroupByLayer=False,
    GroupByType=False,
    IncludeHidden=True,
    IncludeLocked=True,
    LayerFilter="Context - Far::Buildings",
    NameFilter="*",
    SublayerFiltering=True,
    TypeFilter=1073741848)
pipeline_5 = GeometryPipeline(
    GroupByLayer=False,
    GroupByType=False,
    IncludeHidden=True,
    IncludeLocked=True,
    LayerFilter="Context - Near::Ground",
    NameFilter="*",
    SublayerFiltering=True,
    TypeFilter=1073741848)
pipeline_6 = GeometryPipeline(
    GroupByLayer=False,
    GroupByType=False,
    IncludeHidden=True,
    IncludeLocked=True,
    LayerFilter="Site::Ground",
    NameFilter="*",
    SublayerFiltering=True,
    TypeFilter=1073741848)
pipeline_7 = GeometryPipeline(
    GroupByLayer=False,
    GroupByType=False,
    IncludeHidden=True,
    IncludeLocked=True,
    LayerFilter="Site::Buildings",
    NameFilter="*",
    SublayerFiltering=True,
    TypeFilter=1073741848)
mesh = MeshBrep(Brep=pipeline_2, Settings=custom_mesh_settings)
mesh_2 = MeshBrep(Brep=pipeline_7, Settings=custom_mesh_settings)
mesh_3 = MeshBrep(Brep=pipeline_6, Settings=custom_mesh_settings)
mesh_4 = MeshBrep(Brep=pipeline_3, Settings=custom_mesh_settings)
mesh_5 = MeshBrep(Brep=pipeline_5, Settings=custom_mesh_settings)
mesh_6 = MeshBrep(Brep=pipeline_4, Settings=custom_mesh_settings)
mesh_7 = MeshBrep(Brep=pipeline, Settings=custom_mesh_settings)
set_names = SetNames(Meshes=mesh, Names="refinement")  # -> Meshes, Names
set_names_2 = SetNames(Meshes=mesh_3, Names="site_ground")  # -> Meshes, Names
set_names_3 = SetNames(Meshes=mesh_2, Names="site_buildings")  # -> Meshes, Names
set_names_4 = SetNames(Meshes=mesh_7, Names="context_near_buildings")  # -> Meshes, Names
set_names_5 = SetNames(Meshes=mesh_5, Names="context_near_ground")  # -> Meshes, Names
set_names_6 = SetNames(Meshes=[mesh_6, mesh_4], Names="context_far")  # -> Meshes, Names
refinement_region = RefinementRegion(Meshes=set_names.Meshes, Location="inside", MinLevel=Slider(3, range=0..10), MaxLevel=1)
mesh_level = CFDMeshLevel(Meshes=set_names_3.Meshes, MinLevel=Slider(4, range=0..10), MaxLevel=0)
mesh_level_2 = CFDMeshLevel(Meshes=set_names_4.Meshes, MinLevel=Slider(3, range=0..10), MaxLevel=0)
mesh_level_3 = CFDMeshLevel(Meshes=set_names_2.Meshes, MinLevel=Slider(3, range=0..10), MaxLevel=0)
mesh_level_4 = CFDMeshLevel(Meshes=set_names_5.Meshes, MinLevel=Slider(2, range=0..10), MaxLevel=0)
mesh_level_5 = CFDMeshLevel(Meshes=set_names_6.Meshes, MinLevel=Slider(3, range=0..10), MaxLevel=0)

# ----
# LOGIN TO COMPUTE
# This demo is matching version 2021.3.6 of the ComputeGH plugin
panel = Panel("https://compute.procedural.build")
# 0)
password = Text()
login = ComputeLogin(Username="INSERT YOUR USERNAME HERE", Password=password, ComputeURL=panel, Retry=Button())

# ----
# SET BOUNDARY CONDITIONS
panel_2 = Panel("{'U': '{ value uniform (0 -5 0); }'}")
panel_3 = Panel("""MaxZ
MinZ
MinX
MaxX""")
cfd_bc = CFDBoundaryCondition(Names="MinY", Preset=3)
cfd_bc_2 = CFDBoundaryCondition(Names=panel_3, Preset=1)
cfd_bc_3 = CFDBoundaryCondition(Names="MaxY", Preset=2, Overrides=panel_2)
merge = Merge(Data1=cfd_bc_3, Data2=cfd_bc, Data3=cfd_bc_2)

# ----
# GET OR CREATE
# PROJECT AND TASK
panel_4 = Panel("Version 1")
# 1)
project_and_task = GetOrCreateProjectAndTask(Auth=login, ProjectName="Lighthouse", TaskName=panel_4, Create=Button(), Create_2=False)

# ----
# CONFIGURE MESHING
merge_2 = Merge(Data1=mesh_level, Data2=mesh_level_3, Data3=mesh_level_2, Data4=mesh_level_4, Data5=mesh_level_5)
toggle = BooleanToggle(True)
list = ValueList({"3D": 0, "2D": 1}, selected="3D")
domain = CFDDomain(
    Objects=merge_2,
    DomainType=list,
    CellSize=Slider(16, range=0..24),
    Z0=toggle,
    CenterXY=toggle,
    Square=toggle,
    XYScale=Slider(2, range=0..10),
    XYOffset=Slider(0, range=0..100),
    ZScale=Slider(5, range=0..10))  # -> Output, Info, BoundingBox, Mesh
mesh_8 = ComputeMesh(Input=project_and_task, Domain=domain.Output)
panel_5 = Panel(domain.Info)

# ----
# Open Compute in Browser
toggle_2 = BooleanToggle(False)
launch_browser = PythonScript(input=project_and_task, open=toggle_2)  # -> out
# ---------- launch_browser: Python ----------
import webbrowser
import json

taskId = ""
projectId = ""
url = ""

if input:
    input_ = json.loads(input)
    task = input_.get("task")
    project = input_.get("project")
    url = input_.get("url")
    if task:
        taskId = task.get("uid")
    if project:
        projectId = project.get("uid")



if url and taskId:
    url = url + "/project/" + projectId + "/task/" + taskId
    print url
else:
    print "Please provide input from Task/Project component"
    print "GOT url:", url, "TaskId:", taskId
if open:
    webbrowser.open(url, new=2)
# ---------- end launch_browser ----------
# 1a)
panel_6 = Panel(launch_browser)

# ----
# SETUP SOLVER
list_2 = ValueList({"simpleFoam": 0, "potentialFoam": 1, "porousSimpleFoam": 2, "pisoFoam": 3, "buoyantSimpleFoam": 4, "buoyantPimpleFoam": 5, "buoyantBoussinesqSimpleFoam": 6, "buoyantBoussinesqPimpleFoam": 7}, selected="simpleFoam")
list_3 = ValueList({"SimpleCase": 0, "VirtualWindTunnel": 1, "MeshOnly": 2}, selected="VirtualWindTunnel")
# 2)
cfd_solution = ComputeSolution(
    Input=mesh_8,
    CPUs=Slider(24, range=0..100),
    Solver=list_2,
    CaseType=list_3,
    BoundaryConditions=merge,
    Iterations=Slider(1000, range=0..1000),
    NumberOfAngles=Slider(16, range=0..100))

# ----
# CREATE A CUT PLANE
pipeline_8 = GeometryPipeline(
    GroupByLayer=False,
    GroupByType=False,
    IncludeHidden=True,
    IncludeLocked=True,
    LayerFilter="Site::Analysis Surface",
    NameFilter="*",
    SublayerFiltering=True,
    TypeFilter=1073741848)
analysismesh = AnalysisMesh(Surface=pipeline_8, GridSize=Slider(1, range=0..3), Offset=Slider(1.2, range=0..3), OffsetDirection=2)  # -> AnalysisMesh, FaceCenters, FaceNormals
area = Area(Geometry=analysismesh.AnalysisMesh)  # -> Area, Centroid
sort = SortList(Keys=area.Area, ValuesA=analysismesh.AnalysisMesh)  # -> Keys, ValuesA
sort_2 = SortList(Keys=area.Area, ValuesA=analysismesh.FaceCenters)  # -> Keys, ValuesA

# ----
# Display
cull_i = CullIndex(List=domain.Mesh, Indices=-1, Wrap=True)
# Get Started: If you haven't done already, sign up for a free user account at https://compute.procedural.build/ to get started!
# 
# 0) Add your username (email) and password.
# 
# 1) Update the project name, number and task name. To create the new project and task click the button.
# 
# 2) Update the solver configuration or leave the defaults.
# 
# 3) Click the button to upload and start simulating the case.
# 
# 4) Click the button to add the probe points. Make sure to create the C:/Procedural/ComputeVWTDemo folder to store the results in.
# 
# 5) Wait for the simulation to finish and visualise the results. Connect the Utrans values to the wire to see the results when they are done.
# 
# 6) Run the Wind Threshold component to compute the Lawson criteria.
# 
# If you are having any questions, issues or feedback, you are welcome to post them at https://discourse.procedural.build/
# We will be there to answer any queries!
swatch = ColourSwatch(SwatchColor=RGB(0, 0, 0))
medges = MeshEdges(Mesh=sort.ValuesA)  # -> NakedEdges, InteriorEdges, NonManifoldEdges
wires = BrepWireframe(Brep=domain.BoundingBox, Density=-1)
preview = CustomPreview(Geometry=refinement_region, Material=ColourSwatch(SwatchColor=RGBA(168, 168, 168, 130)))
preview_2 = CustomPreview(Geometry=wires, Material=ColourSwatch(SwatchColor=RGB(0, 0, 0)))
preview_3 = CustomPreview(Geometry=cull_i, Material=ColourSwatch(SwatchColor=RGB(153, 153, 153)))
preview_4 = CustomPreview(Geometry=[medges.NakedEdges, medges.InteriorEdges], Material=swatch)
facen = FaceNormals(Mesh=cull_i)  # -> flatten(Centers), Normals
lng = ListLength(List=facen.Centers)
mesh_faces = Panel(lng)

# ----
# RUN ON COMPUTE
button = Button()
# 3)
compute = Compute(Input=cfd_solution, Mesh=domain.Mesh, Compute=button)  # -> Info, Output
panel_7 = Panel(compute.Info)

# ----
# 4)
# PROBE AND DOWNLOAD
panel_8 = Panel("""lowerYard
surroundings
upperYard""")
panel_9 = Panel("""p
Utrans""")
probe_points = ProbePoints(Input=compute.Output, Points=sort_2.ValuesA, Names=panel_8, Fields=panel_9, Create=Button(), Create_2=False)
folder_name = GhPythonScript(BasePath="C:\Procedural", ProjectName="Lighthouse", TaskName=panel_4)  # -> out, ProjectPath, TaskPath
# ---------- folder_name: Python ----------
__author__ = "kongsgaard"
__version__ = "2020.08.31"

import rhinoscriptsyntax as rs
import os

if not BasePath:
    BasePath = "C:\Procedural"

if not ProjectName:
    ProjectName = "Project"
else:
    project_name_ = ProjectName.replace(" ", "_")
    
if not TaskName:
    TaskName = "Task"
else:
    task_name_ = TaskName.replace(" ", "_")
    
ProjectPath = os.path.join(BasePath, project_name_)
TaskPath = os.path.join(BasePath, project_name_, task_name_)
# ---------- end folder_name ----------
concat = Concatenate(FragmentA=folder_name.TaskPath, FragmentB="\probeResults")
download = Download(Input=probe_points, DownloadPath="VWT/postProcessing/internalCloud", LocalPath=concat, Reload=Button())

# ----
# 6)
# RUN WIND THRESHOLD CALCULATION
panel_10 = Panel("\DNK_Copenhagen.061800_IWEC.epw")
download_epw = DownloadEPW(OpenBrowser=Button())
concat_2 = Concatenate(FragmentA=folder_name.ProjectPath, FragmentB=panel_10)
wind_thresholds = WindThresholds(
    EPWFile=concat_2,
    PatchNames=panel_8,
    Thresholds=["{\"field\": \"sitting\", \"value\": 4}", "{\"field\": \"standing\", \"value\": 6}", "{\"field\": \"strolling\", \"value\": 8}", "{\"field\": \"business_walking\", \"value\": 10}", "{\"field\": \"uncomfortable\", \"value\": 10}", "{\"field\": \"unsafe_frail\", \"value\": 15}", "{\"field\": \"unsafe_all\", \"value\": 20}"],
    CPUs=Slider(4, range=1..24),
    Create=Button())
concat_3 = Concatenate(FragmentA=folder_name.TaskPath, FragmentB="\urbanComfort")
download_2 = Download(Input=wind_thresholds, DownloadPath="urbanComfort", LocalPath=concat_3, Reload=Button())

# ----
# VISUALIZE WIND ANGLES
# Visualize Values
button_2 = Button()
# 5)
load_probe_results = LoadProbeResults(Folder=download, Mesh=sort.ValuesA, Rerun=button_2)  # -> Info, Points, Mesh
connect_me_to_utrans = Relay()
panel_11 = Panel(load_probe_results.Info)
panel_12 = Panel("""0,128,0
255,255,0
255,0,0""")

# ----
# VISUALIZE LAWSON CRITERIA
number_slider_2 = Slider(1, range=0..1)
wind_threshold_results = WindThresholdResults(
    Folder=download_2,
    ThresholdType=number_slider_2,
    ThresholdFrequency=["{\"field\": \"sitting\", \"value\": 5}", "{\"field\": \"standing\", \"value\": 5}", "{\"field\": \"strolling\", \"value\": 5}", "{\"field\": \"business_walking\", \"value\": 5}", "{\"field\": \"uncomfortable\", \"value\": 95}", "{\"field\": \"unsafe_frail\", \"value\": 99.977}", "{\"field\": \"unsafe_all\", \"value\": 99.977}"])  # -> Info, Winter_morning, Winter_noon, Winter_afternoon, Winter_evenings, Spring_morning, Spring_noon, Spring_afternoon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
panel_13 = Panel(wind_threshold_results.Info)
# https://compute.procedural.build
connect_me_to_yearly = Relay()
bnd = Bounds(Numbers=flatten(connect_me_to_yearly))
panel_14 = Panel("""75,107,169
234,38,0""")
dedomain = DeconstructDomain(Domain=bnd)  # -> Start, End
recolormesh = RecolorMesh(
    Mesh=load_probe_results.Mesh,
    Result=connect_me_to_yearly,
    ListOfColors=panel_14,
    LowerBoundary=dedomain.Start,
    UpperBoundary=dedomain.End,
    Segments=10)  # -> Recolored, Colors, Values; disabled
legend_prepare = LegendPrepare(D=recolormesh.Colors, D_2=recolormesh.Values)  # -> branch_0, R, rectangle_2, pt_2
panel_15 = Panel("""Lawson Criteria
Yearly""")
legend = Legend(Colour=legend_prepare.branch_0, Tags=legend_prepare.R, Rectangle=legend_prepare.rectangle_2, LegendType=1)
tag = TextTag3D(
    Location=legend_prepare.pt_2,
    Text=panel_15,
    Size=Slider(4, range=0..16),
    Colour=ColourSwatch(SwatchColor=RGB(0, 0, 0)),
    Justification=1)

# ----
# Visualize Vectors
number_slider_3 = Slider(2, range=0..15)
branch_mask = GhPythonScript(Index=number_slider_3)  # -> out, Path
# ---------- branch_mask: Python ----------
__author__ = "kongs"
__version__ = "2020.08.31"

import rhinoscriptsyntax as rs

if not Index:
    Index = 0
    
Path = "{*;" + str(Index) + "}"
# ---------- end branch_mask ----------

split = SplitTree(Data=connect_me_to_utrans, Masks=flatten(branch_mask.Path))  # -> Positive, Negative
vlen = VectorLength(Vector=split.Positive)

bnd_2 = Bounds(Numbers=flatten(vlen))
dedomain_2 = DeconstructDomain(Domain=bnd_2)  # -> Start, End
gradient = Gradient(
    LowerLimit=dedomain_2.Start,
    UpperLimit=dedomain_2.End,
    Parameter=split.Positive,
    stops=[0: RGB(0, 128, 0), 0.5: RGB(255, 255, 0), 1: RGB(255, 0, 0)])
vdisex = VectorDisplayEx(Point=flatten(load_probe_results.Points), Vector=flatten(split.Positive), Colour=flatten(gradient), Width=2)

recolormesh_2 = RecolorMesh(
    Mesh=load_probe_results.Mesh,
    Result=vlen,
    ListOfColors=panel_12,
    LowerBoundary=dedomain_2.Start,
    UpperBoundary=dedomain_2.End,
    Segments=10)  # -> Recolored, Colors, Values
legend_prepare_2 = LegendPrepare(D=recolormesh_2.Colors, D_2=recolormesh_2.Values, C=load_probe_results.Mesh)  # -> branch_0, R, rectangle_2, pt_2

bang = ExplodeTree()  # -> Branch0, Branch1
item = ListItem(List=bang.Branch1, Index=number_slider_3, Wrap=True)
number_slider_4 = Slider(4, range=0..16)
wind_direction = WindDirection(G=legend_prepare_2.pt_2, A=item)
swatch_2 = ColourSwatch(SwatchColor=RGB(0, 0, 0))
text = GhPythonScript(x="Wind Vectors", y=item)  # -> out, a
# ---------- text: Python ----------
__author__ = "kongs"
__version__ = "2020.09.04"

import rhinoscriptsyntax as rs


a = x + "\nWind Direction " + y
# ---------- end text ----------
legend_2 = Legend(Colour=legend_prepare_2.branch_0, Tags=legend_prepare_2.R, Rectangle=legend_prepare_2.rectangle_2, LegendType=1)
text_2 = GhPythonScript(x="Wind Speeds (m/s)", y=item)  # -> out, a; same code as text
tag_2 = TextTag3D(Location=legend_prepare_2.pt_2, Text=text.a, Size=number_slider_4, Colour=swatch_2, Justification=1)
preview_5 = CustomPreview(Geometry=wind_direction, Material=swatch_2)
tag_3 = TextTag3D(Location=legend_prepare_2.pt_2, Text=text_2.a, Size=number_slider_4, Colour=swatch_2, Justification=1)

# ==== cluster LegendPrepare
C = ClusterInput()
D = ClusterInput()
D_2 = ClusterInput()
bbox = BoundingBox(Content=flatten(C), Plane=PlaneXY(0, 0, 0), UnionBox=True)  # -> Box, Box_2
bang = ExplodeTree(Data=D)  # -> Branch0, Branch1, Branch2
bang_2 = ExplodeTree(Data=D_2)  # -> Branch0, Branch1, Branch2
debox = DeconstructBox(Box=bbox.Box)  # -> Plane, X, Y, Z
branch_0 = ClusterOutput(bang.Branch0)
expression = Expression(x=bang_2.Branch0, Expression="Round(x, 2)")
dedomain = DeconstructDomain(Domain=debox.X)  # -> Start, End
dedomain_2 = DeconstructDomain(Domain=debox.Y)  # -> Start, End
neg = Negative(Value=dedomain_2.Start)
R = ClusterOutput(expression)
neg_2 = Negative(Value=dedomain.Start)
addition = Addition(A=neg, B=dedomain_2.End)
pt = ConstructPoint(XCoordinate=dedomain.Start, YCoordinate=dedomain_2.Start, ZCoordinate=0)
addition_2 = Addition(A=neg_2, B=dedomain.End)
multiplication = Multiplication(A=addition_2, B=Slider(0.03, range=0.01..0.2))
multiplication_2 = Multiplication(A=addition, B=0.7)
multiplication_3 = Multiplication(A=addition_2, B=0.05)
pt_2 = ClusterOutput(pt)
addition_3 = Addition(A=dedomain.End, B=multiplication)
pt_3 = ConstructPoint(XCoordinate=addition_3, YCoordinate=dedomain_2.Start, ZCoordinate=0)
dom = ConstructDomain(DomainStart=0, DomainEnd=multiplication_3)
dom_2 = ConstructDomain(DomainStart=0, DomainEnd=multiplication_2)
rectangle = Rectangle(Plane=pt_3, XSize=dom, YSize=dom_2, Radius=0)  # -> Rectangle, Length
rectangle_2 = ClusterOutput(rectangle.Rectangle)

# ==== cluster WindDirection
number_slider = Slider(5, range=0..10)
vec = VectorXYZ(XComponent=number_slider, YComponent=number_slider, ZComponent=0)  # -> Vector, Length
Y = UnitY(Factor=1)
A = ClusterInput()
number_slider_2 = Slider(11, range=0..20)
G = ClusterInput()
rotate = Rotate(Geometry=Y, Angle=degrees(A), Plane=PlaneXY(0, 0, 0))  # -> Geometry, Transform
move = Move(Geometry=G, Motion=vec.Vector)  # -> Geometry, Transform
multiplication = Multiplication(A=number_slider_2, B=0.4)
line = LineSDL(Start=move.Geometry, Direction=rotate.Geometry, Length=number_slider_2)
rotate_2 = Rotate(Geometry=rotate.Geometry, Angle=degrees(Slider(200, range=0..360)), Plane=PlaneXY(0, 0, 0))  # -> Geometry, Transform
end = EndPoints(Curve=line)  # -> Start, End
line_2 = LineSDL(Start=end.End, Direction=rotate_2.Geometry, Length=multiplication)
L = ClusterOutput([line_2, line])
